# Dynamo graph Rename Almost All.dyn (Dynamo 2.5.0.7460)
# packages: Data-Shapes 2022.2.103

string = StringInput("Rename Almost All")
string_2 = StringInput("Text to be replaced")
string_3 = StringInput("Replacement")
string_4 = StringInput("Categories")
string_5 = StringInput("Starts With,Contains,Ends With")
string_6 = StringInput("Replacement Type")
string_7 = StringInput("Processed Elements")
string_8 = StringInput("Materials")
list_create = List.Create(item0=string_2, item1=string_3, item2=string_4, item3=string_5, item4=string_6, item5=string_7, item6=string_8)
code_block = CodeBlock(x=list_create) { x[0]; x[1]; x[2]; x[3]; x[4]; x[5]; x[6]; }

# group: ACTION DATA Collect element types, categories, classes
code_block_2 = CodeBlock { true; }
python_script = Python(IN[0]=code_block_2)
# ---------- python_script.python (15 lines) ----------
import clr
clr.AddReference('RevitAPI')
from Autodesk.Revit.DB import *
import Autodesk
clr.AddReference('RevitNodes')
import Revit
clr.ImportExtensions(Revit.Elements)
import System.Reflection
import System.AppDomain

rAssembly = [x for x in System.AppDomain.CurrentDomain.GetAssemblies() if x.GetName().Name == 'RevitAPI'][0]
rElement = [x for x in rAssembly.GetTypes() if x.Name == 'Element' and x.Namespace == 'Autodesk.Revit.DB'][0]

a = [x for x in rAssembly.GetTypes() if x.IsClass and x.IsSubclassOf(rElement)]
OUT = a, [x.Name for x in a]
# ----------------------------------------
code_block_3 = CodeBlock(x=python_script) { x[0]; x[1]; }
sortByKey = List.SortByKey(list=code_block_3.out0, keys=code_block_3.out1)
code_block_4 = CodeBlock(b=code_block.out6) { b; }
byName = Category.ByName(name=code_block_4)
list_element_types_processed = CodeBlock(a=sortByKey.sorted_list, x=byName) { [a,true, x]; }
flatten = List.Flatten(list=list_element_types_processed)
list_element_types_processed_2 = CodeBlock(a=sortByKey.sorted_keys, b=code_block.out6) { [a,"LineStyles", b]; }
flatten_2 = List.Flatten(list=list_element_types_processed_2)
sortByKey_2 = List.SortByKey(list=flatten, keys=flatten_2)

# group: UI
code_block_5 = CodeBlock { ButtonText_optional : string = "OK"; }
code_block_6 = CodeBlock { "XXX_"; }
textbox_data = Custom[TextBox Data](InputName=code_block.out0, DefaultText=code_block_6)  # package Data-Shapes; Create Data for TextBox input in UI.MultipleInputForm ++ . Check out www.data-shapes.net for more informations
code_block_7 = CodeBlock { "YYY_"; }
code_block_8 = CodeBlock { 250; }
code_block_9 = CodeBlock { false; }
code_block_10 = CodeBlock { false; }
code_block_11 = CodeBlock { false; }
code_block_12 = CodeBlock { DSCore.List.Empty; }
code_block_13 = CodeBlock { false; }
code_block_14 = CodeBlock { true; }
ui_listview_data = Python(IN[0]=code_block.out2, IN[1]=sortByKey_2.sorted_keys, IN[2]=sortByKey_2.sorted_list, IN[3]=code_block_8, IN[4]=code_block_9, IN[5]=code_block_10, IN[6]=code_block_11, IN[7]=code_block_12, IN[8]=code_block_13, IN[9]=code_block_14)
# ---------- ui_listview_data.python (74 lines) ----------
#Copyright (c) mostafa el ayoubi ,  2016
#Data-Shapes www.data-shapes.net , elayoubi.mostafa@gmail.com

class listview():

    def __init__(self,inputname,height,highlight,display_mode,element_count,default_values,sorted,showId):
        self.inputname = inputname
        self.height = height
        self.highlight = highlight
        self.display_mode = display_mode
        self.element_count = element_count
        self.default_values = default_values
        self.sorted = sorted
        self.showId = showId

    def __setitem__(self, key, item):
        self.__dict__[key] = item

    def __getitem__(self, key):
        return self.__dict__[key]

    def __iter__(self):
        return iter(self.__dict__)

    def values(self):
        return self.__dict__.values()

    def keys(self):
        return self.__dict__.keys()

    def __repr__(self):
        return 'UI.ListView input'

if isinstance(IN[1],list):
	in1 = IN[1]
else:
	in1 = [IN[1]]

if isinstance(IN[2],list):
	in2 = IN[2]
else:
	in2 = [IN[2]]

if IN[6]:
	element_count = len(in1)
else:
	element_count = 0

x = listview(IN[0],IN[3],IN[4],IN[5],element_count,IN[7],IN[8],IN[9])

for k,v in zip(in1,in2):
	if x.showId :
		try:
			try:
				x[str(k)+ '  -  id: ' + str(v.Id)] = v
			except:
				x[k.encode('utf-8').decode('utf-8') + '  -  id: ' + str(v.Id)] = v
		except:
			try:
				x[str(k)] = v
			except:
				x[k.encode('utf-8').decode('utf-8')] = v
	else:
		try:
			try:
				x[str(k)] = v
			except:
				x[k.encode('utf-8').decode('utf-8')] = v
		except:
			try:
				x[str(k)] = v
			except:
				x[k.encode('utf-8').decode('utf-8')] = v
OUT = x
# ----------------------------------------
code_block_15 = CodeBlock { ","; }
split = String.Split(str=code_block.out3, separator0=code_block_15)
code_block_16 = CodeBlock { ["Starts with","Contains","Ends with"]; }
code_block_17 = CodeBlock { [0]; }
radio_button = Python(IN[0]=code_block.out4, IN[1]=split, IN[2]=code_block_16, IN[3]=code_block_17)
# ---------- radio_button.python (48 lines) ----------
#Copyright (c) mostafa el ayoubi ,  2017
#Data-Shapes www.data-shapes.net , elayoubi.mostafa@gmail.com


class uiradio():

    def __init__(self,inputname,defaultvalue):
        self.inputname = inputname
        self.defaultvalue = defaultvalue

    def __setitem__(self, key, item):
        self.__dict__[key] = item

    def __getitem__(self, key):
        return self.__dict__[key]

    def __iter__(self):
        return iter(self.__dict__)

    def values(self):
        return self.__dict__.values()

    def keys(self):
        return self.__dict__.keys()

    def __repr__(self):
        return 'UI.Radio input'
        
x = uiradio(IN[0],IN[3])

if isinstance(IN[1],list):
	in1 = IN[1]
else:
	in1 = [IN[1]]
if isinstance(IN[2],list):
	in2 = IN[2]
else:
	in2 = [IN[2]]
	

for k,v in zip(in1,in2):
	try:
		x[str(k)] = v
	except:
		x[k.encode('utf-8').decode('utf-8')] = v


OUT = x
# ----------------------------------------
boolean = BoolSelector(true)
code_block_18 = CodeBlock { null; }
code_block_19 = CodeBlock { "Cancel"; }

textbox_data_2 = Custom[TextBox Data](InputName=code_block.out1, DefaultText=code_block_7)

# group (continued): UI
list_create_2 = List.Create(item0=textbox_data, item1=textbox_data_2, item2=ui_listview_data, item3=radio_button)
multipleinputform = Custom[MultipleInputForm ++](Description_optional=string, ButtonText_optional=code_block_5, Inputs=list_create_2, Toggle=boolean, LinkToHelp_optional=code_block_18, CancelButtonText_optional=code_block_19)  # package Data-Shapes; Create a form with multiple inputs. see www.data-shapes.net for tutorials and infos!

code_block_20 = CodeBlock(x=multipleinputform.User_Inputs) { x[0]; x[1]; x[2]; x[3]; }

# group: split list of items by types
type = Object.Type(obj=code_block_20.out2)
groupByKey = List.GroupByKey(list=type, keys=type)
count = List.Count(list=groupByKey.groups, lacing=Longest)
chop = List.Chop(list=code_block_20.out2, lengths=count)

code_block_21 = CodeBlock(x=type) { x=="Revit.Elements.Category"; }
code_block_22 = CodeBlock { null; }
if_ = If(test=code_block_21, true=code_block_20.out2, false=code_block_22)
code_block_23 = CodeBlock { false; }
clean = List.Clean(list=if_, preserveIndices=code_block_23)
all_elements_of_category = ElementsOfCategory(Category=clean)
flatten_3 = List.Flatten(list=all_elements_of_category)
code_block_24 = CodeBlock(e=all_elements_of_category) { e.Name; }
flatten_4 = List.Flatten(list=code_block_24)

# group: Starts with
startsWith = String.StartsWith(str=flatten_4, searchFor=code_block_20.out0)
filterByBoolMask = List.FilterByBoolMask(list=flatten_4, mask=startsWith)
replace = String.Replace(str=filterByBoolMask.in, searchFor=code_block_20.out0, replaceWith=code_block_20.out1)

# group: Contains
contains = String.Contains(str=flatten_4, searchFor=code_block_20.out0)
filterByBoolMask_2 = List.FilterByBoolMask(list=flatten_4, mask=contains)
replace_2 = String.Replace(str=filterByBoolMask_2.in, searchFor=code_block_20.out0, replaceWith=code_block_20.out1)

# group: Ends with
endsWith = String.EndsWith(str=flatten_4, searchFor=code_block_20.out0)
filterByBoolMask_3 = List.FilterByBoolMask(list=flatten_4, mask=endsWith)
replace_3 = String.Replace(str=filterByBoolMask_3.in, searchFor=code_block_20.out0, replaceWith=code_block_20.out1)

# group: Elements/option
filterByBoolMask_4 = List.FilterByBoolMask(list=flatten_3, mask=startsWith)
filterByBoolMask_5 = List.FilterByBoolMask(list=flatten_3, mask=contains)
filterByBoolMask_6 = List.FilterByBoolMask(list=flatten_3, mask=endsWith)

code_block_25 = CodeBlock(L1=filterByBoolMask_4.in, L2=filterByBoolMask_5.in, L3=filterByBoolMask_6.in, a=code_block_20.out3) { choice = [L1,L2,L3]; choice[a=="Starts with"?0:a=="Contains"?1:2]; }
flatten_5 = List.Flatten(list=code_block_25.out1)
code_block_26 = CodeBlock(L1=replace, L2=replace_2, L3=replace_3, a=code_block_20.out3) { choice = [L1,L2,L3]; choice[a=="Starts with"?0:a=="Contains"?1:2]; }
flatten_6 = List.Flatten(list=code_block_26.out1)

# group: ACTION DATA Rename materials
python_script_2 = Python(IN[0]=flatten_5, IN[1]=flatten_6)
# ---------- python_script_2.python (30 lines) ----------
import clr
clr.AddReference('RevitAPI')
from Autodesk.Revit.DB import *

clr.AddReference("RevitNodes")
import Revit
clr.ImportExtensions(Revit.Elements)

clr.AddReference("RevitServices")
import RevitServices
from RevitServices.Persistence import DocumentManager
from RevitServices.Transactions import TransactionManager

doc = DocumentManager.Instance.CurrentDBDocument
items = UnwrapElement(IN[0])
names = IN[1]
booleans = []
counter = 0

TransactionManager.Instance.EnsureInTransaction(doc)
while counter < len(items):
	try:
		items[counter].Name = names[counter]
		booleans.append(True)
	except:
		booleans.append(False)
	counter += 1
TransactionManager.Instance.TransactionTaskDone()

OUT = items, booleans
# ----------------------------------------

all_elements_of_type = ElementsOfType(element_type=chop)
code_block_27 = CodeBlock { false; }
clean_2 = List.Clean(list=all_elements_of_type, preserveIndices=code_block_27)
flatten_7 = List.Flatten(list=clean_2)
code_block_28 = CodeBlock(e=clean_2) { e.Name; }
flatten_8 = List.Flatten(list=code_block_28)

# group: Starts with
startsWith_2 = String.StartsWith(str=flatten_8, searchFor=code_block_20.out0)
filterByBoolMask_7 = List.FilterByBoolMask(list=flatten_8, mask=startsWith_2)
replace_4 = String.Replace(str=filterByBoolMask_7.in, searchFor=code_block_20.out0, replaceWith=code_block_20.out1)

# group: Contains
contains_2 = String.Contains(str=flatten_8, searchFor=code_block_20.out0)
filterByBoolMask_8 = List.FilterByBoolMask(list=flatten_8, mask=contains_2)
replace_5 = String.Replace(str=filterByBoolMask_8.in, searchFor=code_block_20.out0, replaceWith=code_block_20.out1)

# group: Ends with
endsWith_2 = String.EndsWith(str=flatten_8, searchFor=code_block_20.out0)
filterByBoolMask_9 = List.FilterByBoolMask(list=flatten_8, mask=endsWith_2)
replace_6 = String.Replace(str=filterByBoolMask_9.in, searchFor=code_block_20.out0, replaceWith=code_block_20.out1)

# group: Elements/option
filterByBoolMask_10 = List.FilterByBoolMask(list=flatten_7, mask=startsWith_2)
filterByBoolMask_11 = List.FilterByBoolMask(list=flatten_7, mask=contains_2)
filterByBoolMask_12 = List.FilterByBoolMask(list=flatten_7, mask=endsWith_2)

code_block_29 = CodeBlock(L1=filterByBoolMask_10.in, L2=filterByBoolMask_11.in, L3=filterByBoolMask_12.in, a=code_block_20.out3) { choice = [L1,L2,L3]; choice[a=="Starts with"?0:a=="Contains"?1:2]; }
flatten_9 = List.Flatten(list=code_block_29.out1)
code_block_30 = CodeBlock(L1=replace_4, L2=replace_5, L3=replace_6, a=code_block_20.out3) { choice = [L1,L2,L3]; choice[a=="Starts with"?0:a=="Contains"?1:2]; }
flatten_10 = List.Flatten(list=code_block_30.out1)

# group: ACTION DATA Rename categories
python_script_3 = Python(IN[0]=flatten_9, IN[1]=flatten_10)  # same code as python_script_2

code_block_31 = CodeBlock(x=chop) { x[0]; x[1]; }

# group: Line Styles
python_script_4 = Python()  # unwired: IN[0]
# ---------- python_script_4.python (40 lines) ----------
#python nodes in dynamo 1.0
#proposed by Julien Benoit @jbenoit44 
#http://aecuandme.wordpress.com/
import clr
clr.AddReference("RevitNodes")
import Revit
clr.ImportExtensions(Revit.Elements)
# Import geometry conversion extension methods
clr.ImportExtensions(Revit.GeometryConversion)
# Import DocumentManager and TransactionManager
clr.AddReference("RevitServices")
import RevitServices
from RevitServices.Persistence import DocumentManager
from RevitServices.Transactions import TransactionManager
from System.Collections.Generic import *
# Import RevitAPI
clr.AddReference("RevitAPI")
import Autodesk
from Autodesk.Revit.DB import *

doc = DocumentManager.Instance.CurrentDBDocument
uiapp = DocumentManager.Instance.CurrentUIApplication
app = uiapp.Application
uidoc=DocumentManager.Instance.CurrentUIApplication.ActiveUIDocument
TransactionManager.Instance.EnsureInTransaction(doc)

elt = []
list=[]
a=UnwrapElement(IN[0])
a=doc.Settings.Categories.get_Item(BuiltInCategory.OST_Lines)
b=a.SubCategories

for i in b:
	c=i.Name.ToString()
	list.append(c)
	
# End Transaction
TransactionManager.Instance.TransactionTaskDone()

OUT = b,list
# ----------------------------------------
code_block_32 = CodeBlock(list=python_script_4) { list[0]; list[1]; }
code_block_33 = CodeBlock(x=code_block_31.out1, a=code_block_32.out0) { x==true?[a]:null; }

flatten_11 = List.Flatten(list=code_block_33)

# group: Starts with
startsWith_3 = String.StartsWith(str=code_block_32.out1, searchFor=code_block_20.out0)
filterByBoolMask_13 = List.FilterByBoolMask(list=code_block_32.out1, mask=startsWith_3)
replace_7 = String.Replace(str=filterByBoolMask_13.in, searchFor=code_block_20.out0, replaceWith=code_block_20.out1)

# group: Contains
contains_3 = String.Contains(str=code_block_32.out1, searchFor=code_block_20.out0)
filterByBoolMask_14 = List.FilterByBoolMask(list=code_block_32.out1, mask=contains_3)
replace_8 = String.Replace(str=filterByBoolMask_14.in, searchFor=code_block_20.out0, replaceWith=code_block_20.out1)

# group: Ends with
endsWith_3 = String.EndsWith(str=code_block_32.out1, searchFor=code_block_20.out0)
filterByBoolMask_15 = List.FilterByBoolMask(list=code_block_32.out1, mask=endsWith_3)
replace_9 = String.Replace(str=filterByBoolMask_15.in, searchFor=code_block_20.out0, replaceWith=code_block_20.out1)

# group: Elements/option
filterByBoolMask_16 = List.FilterByBoolMask(list=flatten_11, mask=startsWith_3)
filterByBoolMask_17 = List.FilterByBoolMask(list=flatten_11, mask=contains_3)
filterByBoolMask_18 = List.FilterByBoolMask(list=flatten_11, mask=endsWith_3)

code_block_34 = CodeBlock(L1=filterByBoolMask_16.in, L2=filterByBoolMask_17.in, L3=filterByBoolMask_18.in, a=code_block_20.out3) { choice = [L1,L2,L3]; choice[a=="Starts with"?0:a=="Contains"?1:2]; }
code_block_35 = CodeBlock(L1=replace_7, L2=replace_8, L3=replace_9, a=code_block_20.out3) { choice = [L1,L2,L3]; choice[a=="Starts with"?0:a=="Contains"?1:2]; }

# group: ACTION DATA Rename LineStyles
rename_sub_categories = Python(IN[0]=code_block_34.out1, IN[1]=code_block_35.out1)
# ---------- rename_sub_categories.python (28 lines) ----------
import clr
clr.AddReference('RevitAPI')
import Autodesk
from Autodesk.Revit.DB import *
clr.AddReference("RevitServices")
import RevitServices
from RevitServices.Persistence import DocumentManager
from RevitServices.Transactions import TransactionManager


doc = DocumentManager.Instance.CurrentDBDocument
categoryList = UnwrapElement(IN[0])
names = IN[1]

TransactionManager.Instance.EnsureInTransaction(doc)
for cat,j in zip(categoryList,names):
	try:
		eid = cat.Id
		type = doc.GetElement(eid)
		
		if type:
			type.Name = j
	except:
		continue

TransactionManager.Instance.TransactionTaskDone()
	
OUT = names
# ----------------------------------------

end = Revit.Transaction.Transaction.End(input=python_script_3)

# group: MONITORING Count Items processed
code_block_36 = CodeBlock(x=python_script_2) { x[1]; }
countTrue = List.CountTrue(list=code_block_36)
code_block_37 = CodeBlock(x=python_script_3) { x[1]; }
countTrue_2 = List.CountTrue(list=code_block_37)
count_2 = List.Count(list=rename_sub_categories)
list_create_3 = List.Create(item0=countTrue, item1=countTrue_2, item2=count_2)
code_block_38 = CodeBlock { false; }
clean_3 = List.Clean(list=list_create_3, preserveIndices=code_block_38)
code_block_39 = CodeBlock(a=clean_3) { Sum(a); }
code_block_40 = CodeBlock(passthrough=code_block_39, waitfor=end) { [passthrough,waitfor][0]; }

# group: MONITOR How many elements treated
python_script_5 = Python(IN[0]=code_block_40, IN[1]=code_block.out5)
# ---------- python_script_5.python (12 lines) ----------
# BIM One Inc. - Jean-Marc Couffin - 2019

import clr
clr.AddReference('RevitAPIUI')
from Autodesk.Revit.UI import TaskDialog


txt = IN[1]
count = str(IN[0]) + ' ' + IN[1]


TaskDialog.Show( txt, count)
# ----------------------------------------
